# Grasshopper definition build_radiance_model.gh (Grasshopper 1.0.8)
# plug-ins: Pufferfish, Human, HDTTreeUtils

panel = Panel("*::Short Grass")

panel_2 = Panel("*::Grey Asphalt")
dynamic_geometry_pipeline = DynamicGeometryPipeline(
    LayerFilter="*Ground Plane*::*",
    TypeFilter="All",
    NameFilter="*",
    GroupByLayer=False,
    GroupByType=False,
    IncludeHidden=True,
    IncludeLocked=True,
    enableFullPath=True,
    listenToAttributes=True)
object_attributes = ObjectAttributes(ObjectOrAttributes=dynamic_geometry_pipeline)  # -> Name, LayerName, LayerFullPath, Color, MaterialName, LinetypeName, GroupIndices, PlotWeight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
text_split = TextSplit(Text=object_attributes.LayerName, Separators="_")
list_item = ListItem(List=text_split, Index=Slider(0, range=0..100), Wrap=True)  # -> flatten(Item)

# ----
# TODO: Implement some sort of vegetation import
panel_3 = Panel("*Vegetation*::*")
dynamic_geometry_pipeline_2 = DynamicGeometryPipeline(
    LayerFilter=panel_3,
    TypeFilter="All",
    NameFilter="*",
    GroupByLayer=False,
    GroupByType=False,
    IncludeHidden=True,
    IncludeLocked=True,
    enableFullPath=True,
    listenToAttributes=True)
object_attributes_2 = ObjectAttributes(ObjectOrAttributes=dynamic_geometry_pipeline_2)  # -> Name, LayerName, LayerFullPath, Color, MaterialName, LinetypeName, GroupIndices, PlotWeight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
text_split_2 = TextSplit(Text=object_attributes_2.LayerName, Separators="_")
list_item_2 = ListItem(List=text_split_2, Index=Slider(0, range=0..100), Wrap=True)  # -> flatten(Item)

dynamic_geometry_pipeline_3 = DynamicGeometryPipeline(
    LayerFilter="*Shoebox Model::*",
    TypeFilter="All",
    NameFilter="*",
    GroupByLayer=False,
    GroupByType=False,
    IncludeHidden=True,
    IncludeLocked=True,
    enableFullPath=True,
    listenToAttributes=True)
object_attributes_3 = ObjectAttributes(ObjectOrAttributes=dynamic_geometry_pipeline_3)  # -> Name, LayerName, LayerFullPath, Color, MaterialName, LinetypeName, GroupIndices, PlotWeight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
text_split_3 = TextSplit(Text=object_attributes_3.LayerName, Separators="_")
list_item_3 = ListItem(List=text_split_3, Index=Slider(0, range=0..100), Wrap=True)  # -> flatten(Item)

dynamic_geometry_pipeline_4 = DynamicGeometryPipeline(
    LayerFilter="*within Buffer*::*",
    TypeFilter="All",
    NameFilter="*",
    GroupByLayer=False,
    GroupByType=False,
    IncludeHidden=True,
    IncludeLocked=True,
    enableFullPath=True,
    listenToAttributes=True)
object_attributes_4 = ObjectAttributes(ObjectOrAttributes=dynamic_geometry_pipeline_4)  # -> Name, LayerName, LayerFullPath, Color, MaterialName, LinetypeName, GroupIndices, PlotWeight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
text_split_4 = TextSplit(Text=object_attributes_4.LayerName, Separators="_")
list_item_4 = ListItem(List=text_split_4, Index=Slider(0, range=0..100), Wrap=True)  # -> flatten(Item)

# ---- group: Load tree species data
path = FilePath("/Users/jmccarty/Nextcloud/Projects/35_UHI_Trees_Manitoba/00_data_code/DLA_area_tree_data.csv")
file = ReadFile(File=path, PerLineParse=True)
split = TextSplit(Text=file, Separators=",")
flip = FlipMatrix(Data=split)
split_2 = SplitList(List=flip, Index=Slider(1, range=0..1))  # -> ListA, simplify(ListB)
crv = Curve(<curve referenced from the Rhino model>)
bang = ExplodeTree(Data=split_2.ListB)  # -> Branch0, Branch1, Branch2, Branch3, Branch4, Branch5
end = EndPoints(Curve=crv)  # -> Start, End
pt = ConstructPoint(XCoordinate=bang.Branch0, YCoordinate=bang.Branch1, ZCoordinate=0)
vec2pt = Vector2Pt(PointA=end.Start, PointB=end.End, Unitize=False)  # -> Vector, Length
move = Move(Geometry=pt, Motion=vec2pt.Vector)  # -> Geometry, Transform

# ----
entwine_material_names = Entwine(Branch00=list_item_3, Branch01=list_item, Branch02=list_item_2, Branch03=list_item_4, FlattenInputs=True)
entwine_geometry = Entwine(
    Branch00=dynamic_geometry_pipeline_3,
    Branch01=dynamic_geometry_pipeline,
    Branch02=dynamic_geometry_pipeline_2,
    Branch03=dynamic_geometry_pipeline_4,
    FlattenInputs=True)
clean_tree = CleanTree(RemoveNulls=True, RemoveInvalid=True, RemoveEmpty=True, Tree=entwine_geometry)
clean_tree_2 = CleanTree(RemoveNulls=True, RemoveInvalid=True, RemoveEmpty=True, Tree=entwine_material_names)
create_set = CreateSet(List=flatten(clean_tree_2))  # -> Set, Map
unique_materials = Panel(create_set.Set)
ghpython_script = GhPythonScript(x=clean_tree_2)  # -> out, a
# ---------- ghpython_script: Python ----------
a = x.lower().replace(" ","_")
# ---------- end ghpython_script ----------

bounding_rectangle = BoundingRectangle(Geometry=dynamic_geometry_pipeline, Plane=PlaneXY(0, 0, 0), Axis=0, Slide=0, Union=True)  # -> Bounding, DimensionX, DimensionY
area = Area(Geometry=bounding_rectangle.Bounding)  # -> Area, Centroid
point = Point(Point(0, 0, 0))
vector_2pt = Vector2Pt(PointA=area.Centroid, PointB=point, Unitize=False)  # -> Vector, Length

# ---- group: Move trees to working plane
move_2 = Move(Geometry=move.Geometry, Motion=vector_2pt.Vector)  # -> Geometry, Transform
item = ListItem(List=move_2.Geometry, Index=0, Wrap=True)
pdecon = Deconstruct(Point=item)  # -> XComponent, YComponent, ZComponent
Z = UnitZ(Factor=1)
subtraction = Subtraction(A="0", B=pdecon.ZComponent)
amp = Amplitude(Vector=Z, Amplitude=subtraction)
move_3 = Move(Geometry=move_2.Geometry, Motion=amp)  # -> Geometry, Transform

# ----
group = Group(Geometry=clean_tree)
cset = CreateSet(List=flatten(ghpython_script.a))  # -> Set, Map
# materials: void plastic grey_limestone 0 0 5 0.5066 0.4552 0.3670 0.0017 0.3000
# void plastic grey_concrete 0 0 5 0.3547 0.3305 0.2794 0.0008 0.3000
# void plastic grey_precast_concrete 0 0 5 0.3547 0.3305 0.2794 0.0008 0.3000
# void plastic grey_asphalt 0 0 5 0.2565 0.2354 0.1961 0.0001 0.3000
# void plastic short_grass 0 0 5 0.1713 0.1763 0.0632 0.0003 0.2000
# void plastic tall_grass 0 0 5 0.0788 0.0770 0.0209 0.0000 0.0000
# void plastic light_grey_unit_pavers 0 0 5 0.1638 0.1453 0.1183 0.0000 0.3000
# void plastic tan_small_stone_aggregate 0 0 5 0.3853 0.3358 0.2572 0.0000 0.0000
# void glass conifer 0 0 4 0.23 0.14 0.88 1.15
# void glass deciduous 0 0 4 0.23 0.14 0.88 1.15
# void glass glass 0 0 4 0.6976 0.6976 0.6976 1.52
# void plastic generic 0 0 5 0.2 0.2 0.2 0.0008 0.3000
# void plastic jar_building_stairs 0 0 5 0.2037 0.2218 0.2189 0.0057 0.2000
# void plastic black_brick 0 0 5 0.0490 0.0405 0.0394 0.0000 0.3000
panel_4 = Panel(cset.Set)
move_4 = Move(Geometry=group, Motion=vector_2pt.Vector)  # -> Geometry, Transform
ungroup = Ungroup(Group=move_4.Geometry)  # -> simplify(Geometry)

# ---- group: Based on layers extract material types
materials = Panel("""void plastic grey_limestone 0 0 5 0.5066 0.4552 0.3670 0.0017 0.3000
void plastic grey_concrete 0 0 5 0.3547 0.3305 0.2794 0.0008 0.3000
void plastic grey_precast_concrete 0 0 5 0.3547 0.3305 0.2794 0.0008 0.3000
void plastic grey_asphalt 0 0 5 0.2565 0.2354 0.1961 0.0001 0.3000
void plastic short_grass 0 0 5 0.1713 0.1763 0.0632 0.0003 0.2000
void plastic tall_grass 0 0 5 0.0788 0.0770 0.0209 0.0000 0.0000
void plastic light_grey_unit_pavers 0 0 5 0.1638 0.1453 0.1183 0.0000 0.3000
void plastic tan_small_stone_aggregate 0 0 5 0.1638 0.1453 0.1183 0.0000 0.3000
void glass conifer 0 0 4 0.23 0.14 0.88 1.15
void glass deciduous 0 0 4 0.23 0.14 0.88 1.15
void glass glass 0 0 4 0.6976 0.6976 0.6976 1.52
void plastic generic 0 0 5 0.2 0.2 0.2 0.0008 0.3000
void plastic jar_building_stairs 0 0 5 0.2 0.2 0.2 0.0008 0.3000
void plastic black_brick 0 0 5 0.2 0.2 0.2 0.0008 0.3000""")
parse_to_rad_material = GhPythonScript(x=materials)  # -> out, name, modifier
# ---------- parse_to_rad_material: Python ----------
from honeybee_radiance.modifier.material import Plastic
from honeybee_radiance.modifier.material import Glass

import re
data = x.split("\n")
name = re.split(u"[\,\u2028]", data[0])[0]
name = name.split(" ")[-1]

def_string = re.split(u"[\,\u2028]", data[0])[-1]

defs = [float(n) for n in def_string.split(" ")][1:]


if len(defs)==5:
    r = defs[0]
    g = defs[1]
    b = defs[2]
    spec = defs[3]
    rough = defs[4]
    modifier = Plastic.from_reflected_specularity(name, r, g, b, spec, rough)
elif len(defs)==4:
    r = defs[0]
    g = defs[1]
    b = defs[2]
    refract = defs[3]
    modifier = Glass.from_transmittance(name, r, g, b, refract)
else:
    print("unknown")
# ---------- end parse_to_rad_material ----------
member_index = MemberIndex(Set=parse_to_rad_material.name, Member=ghpython_script.a)  # -> Index, Count
trim_tree = TrimTree(Tree=member_index.Index, Depth=1)
list_item_5 = ListItem(List=parse_to_rad_material.modifier, Index=trim_tree, Wrap=True)

# ----
bang_2 = ExplodeTree(Data=ungroup)  # -> _0000, Branch1, Branch2
entwine = Entwine(Branch00=flatten(bang_2._0000), Branch01=flatten(bang_2.Branch1), Branch02=flatten(bang_2.Branch2), FlattenInputs=True)
branch = TreeBranch(Tree=entwine, Path="{0;1}", MaintainPaths=True)

branch_2 = TreeBranch(Tree=entwine, Path="{0;0}", MaintainPaths=True)  # -> graft(Branch)
branch_3 = TreeBranch(Tree=list_item_5, Path="{0;0}", MaintainPaths=True)  # -> graft(Branch)
branch_4 = TreeBranch(Tree=ghpython_script.a, Path="{0;0}", MaintainPaths=True)
mesh = MeshBrep(
    Brep=branch_2,
    Settings={GridMaxCount=0, GridMinCount=16, JaggedSeams=False, MaxEdgeLength=0, MinEdgeLength=0.0001, MinTolerance=0, Refine=True, RefineAngle=0, RelativeTolerance=0.65, SimplePlanes=True, Tolerance=0})
demesh = DeconstructMesh(Mesh=mesh)  # -> Vertices, Faces, Colours, Normals
trim = TrimTree(Tree=demesh.Faces, Depth=1)
lng = ListLength(List=trim)  # -> flatten(Length)
faceb = FaceBoundaries(Mesh=mesh)  # -> graft(Boundaries)
name_surfaces = Python3Script(surface_mats=branch_4, sub_face_length=lng, surface_type="facade")  # -> out, flatten(surface_idx); inputs surface_mats: list, sub_face_length: list
# ---------- name_surfaces: Python ----------
list_length = len(surface_mats)

surface_idx_pre = [f"{str(n).zfill(len(str(list_length)))}" for n in range(0,list_length)]

surface_idx_post = []
for n, mat in enumerate(surface_mats):
    surface_name = f"{surface_idx_pre[n]}_{mat}"
    surface_idx_post.append(surface_name)

surface_idx = []
for n, surface in enumerate(surface_idx_post):
    sub_face_range = range(0, sub_face_length[n])
    for sub_n in sub_face_range:
        surface_idx.append(f"{surface_type}_{surface}_{str(sub_n).zfill(4)}")
# ---------- end name_surfaces ----------
repeat = RepeatData(Data=branch_3, Length=graft(lng))  # -> flatten(Data)
srf = Surface(faceb)
area_2 = Area(Geometry=branch_2)  # -> Area, Centroid
trim_2 = TrimTree(Tree=area_2.Area, Depth=1)
dpath = DeconstructPath(Branch=simplify(trim_2))  # -> flatten(Indices)
surface_area_csv = Python3Script(surface_type="facade", idx=dpath, area=flatten(trim_2))  # -> out, a
# ---------- surface_area_csv: Python ----------
a = f"{surface_type},{str(idx).zfill(3)},{round(area,2)}"
# ---------- end surface_area_csv ----------
panel_5 = Panel(surface_area_csv.a)
face = HBFace(geo=flatten(srf), name=name_surfaces.surface_idx, rad_mod=repeat)  # -> report, faces; plug-in component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

branch_5 = TreeBranch(Tree=entwine, Path="{0;1}", MaintainPaths=True)  # -> graft(Branch)
branch_6 = TreeBranch(Tree=list_item_5, Path="{0;1}", MaintainPaths=True)  # -> graft(Branch)
branch_7 = TreeBranch(Tree=ghpython_script.a, Path="{0;1}", MaintainPaths=True)
mesh_2 = MeshBrep(
    Brep=branch_5,
    Settings={GridMaxCount=0, GridMinCount=16, JaggedSeams=False, MaxEdgeLength=0, MinEdgeLength=0.0001, MinTolerance=0, Refine=True, RefineAngle=0, RelativeTolerance=0.65, SimplePlanes=True, Tolerance=0})
demesh_2 = DeconstructMesh(Mesh=mesh_2)  # -> Vertices, Faces, Colours, Normals
trim_3 = TrimTree(Tree=demesh_2.Faces, Depth=1)
lng_2 = ListLength(List=trim_3)  # -> flatten(Length)
faceb_2 = FaceBoundaries(Mesh=mesh_2)  # -> graft(Boundaries)
name_surfaces_2 = Python3Script(surface_mats=branch_7, sub_face_length=lng_2, surface_type="ground")  # -> out, flatten(surface_idx); inputs surface_mats: list, sub_face_length: list; same code as name_surfaces
repeat_2 = RepeatData(Data=branch_6, Length=graft(lng_2))  # -> flatten(Data)
srf_2 = Surface(faceb_2)
area_3 = Area(Geometry=branch_5)  # -> Area, Centroid
trim_4 = TrimTree(Tree=area_3.Area, Depth=1)
dpath_2 = DeconstructPath(Branch=simplify(trim_4))  # -> flatten(Indices)
surface_area_csv_2 = Python3Script(surface_type="ground", idx=dpath_2, area=flatten(trim_4))  # -> out, a; same code as surface_area_csv
panel_6 = Panel(surface_area_csv_2.a)
face_2 = HBFace(geo=flatten(srf_2), name=name_surfaces_2.surface_idx, rad_mod=repeat_2)  # -> report, faces; plug-in component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

branch_8 = TreeBranch(Tree=entwine, Path="{0;2}", MaintainPaths=True)  # -> graft(Branch)
branch_9 = TreeBranch(Tree=list_item_5, Path="{0;2}", MaintainPaths=True)  # -> graft(Branch)
branch_10 = TreeBranch(Tree=ghpython_script.a, Path="{0;2}", MaintainPaths=True)
demesh_3 = DeconstructMesh(Mesh=branch_8)  # -> Vertices, Faces, Colours, Normals
trim_5 = TrimTree(Tree=demesh_3.Faces, Depth=1)
lng_3 = ListLength(List=trim_5)  # -> flatten(Length)
faceb_3 = FaceBoundaries(Mesh=branch_8)  # -> graft(Boundaries)
name_surfaces_3 = Python3Script(surface_mats=branch_10, sub_face_length=lng_3, surface_type="vegetation")  # -> out, flatten(surface_idx); inputs surface_mats: list, sub_face_length: list; same code as name_surfaces
repeat_3 = RepeatData(Data=branch_9, Length=graft(lng_3))  # -> flatten(Data)
srf_3 = Surface(faceb_3)
area_4 = Area(Geometry=branch_8)  # -> Area, Centroid
trim_6 = TrimTree(Tree=area_4.Area, Depth=1)
dpath_3 = DeconstructPath(Branch=simplify(trim_6))  # -> flatten(Indices)
surface_area_csv_3 = Python3Script(surface_type="vegetation", idx=dpath_3, area=flatten(trim_6))  # -> out, a; same code as surface_area_csv
panel_7 = Panel(surface_area_csv_3.a)
face_3 = HBFace(geo=flatten(srf_3), name=name_surfaces_3.surface_idx, rad_mod=repeat_3)  # -> report, faces; plug-in component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

# ---- group: Find Tree Mesh species based on first intersection
Z_2 = UnitZ(Factor=1)
amp_2 = Amplitude(Vector=Z_2, Amplitude=Slider(20, range=0..100))
listdexs = ListIndices(List=move_3.Geometry)
meshray = MeshRay(Mesh=branch_8, Point=move_3.Geometry, Direction=amp_2)  # -> Point, Hit
dispatch = Dispatch(List=listdexs, DispatchPattern=meshray.Hit)  # -> ListA, ListB
panel_8 = Panel(dispatch.ListA)
lng_4 = ListLength(List=bang.Branch2)
item_2 = ListItem(List=dispatch.ListA, Index=0, Wrap=True)
nullrep = ReplaceNulls(Items=item_2, Replacements=lng_4)  # -> Items, Count
panel_9 = Panel(nullrep.Items)

# ---- group: Add default option to species list
cset_2 = CreateSet(List=bang.Branch2)  # -> Set, Map
mindex = MemberIndex(Set=bang.Branch2, Member=graft(cset_2.Set))  # -> Index, Count
lng_5 = ListLength(List=mindex.Index)
listdexs_2 = ListIndices(List=cset_2.Set)
sort = SortList(Keys=flatten(lng_5), ValuesA=listdexs_2)  # -> reverse(Keys), reverse(ValuesA)
item_3 = ListItem(List=sort.ValuesA, Index=0, Wrap=True)
item_4 = ListItem(List=cset_2.Set, Index=item_3, Wrap=True)
ins = InsertItems(List=bang.Branch2, Item=item_4, Indices=lng_4, Wrap=True)

# ----
map_common_to_lation = Python3Script(x=cset_2.Set)  # -> out, a
# ---------- map_common_to_lation: Python ----------
naming_dict = {
    "White Spruce":"Picea_glauca",
    "American Elm":"Ulmus_americana",
    "Green Ash":"Fraxinus_pennsylvanica",
    "Silver Maple":"Acer_saccharinum",
    "Siberian Elm":"Ulmus_pumila",
    "Russian Olive":"Elaeagnus_angustifolia",
    "American Linden":"Tilia_americana",
    "Amur Maple":"Acer_ginnala",
    "Scots Pine":"Pinus_sylvestris",
    "Colorado Blue Spruce":"Picea_pungens",
    "Japanese Tree Lilac":"Syringa_reticulata",
    "Tamarack":"Larix_laricina",
    "Ponderosa Pine":"Pinus_ponderosa",
    "Manitoba Maple":"Acer_negundo",
    "Bur Oak":"Quercus_macrocarpa",
    "Crabapple Rosybloom":"Malus_hybrida",
    "Northern Pin Oak":"Quercus_ellipsoidalis",
    "Hackberry":"Celtis_occidentalis",
    "Elm-Japanese":"Ulmus_davidiana_var_japonica",
    "Amur Chokecherry":"Prunus_maackii",
    "Dropmore Linden":"Tilia_×_flavescens",
    "Juniper":"Juniperus_spp",
    "Black Ash":"Fraxinus_nigra",
    "Ash-Mancana":"Fraxinus_mandshurica",
    "Tower Poplar":"Populus_×_canescens",
    "Schubert Chokecherry":"Prunus_virginiana_Schubert",
    "Cedar":"Thuja_spp",
    "Hawthorn":"Crataegus_spp",
    "Siberian Crabapple":"Malus_baccata",
    "Showy Mountain Ash":"Sorbus_decora",
    "Black Spruce":"Picea_mariana",
    "Ohio buckeye":"Aesculus_glabra",
    "Alder":"Alnus_spp",
}

a = naming_dict[x]
# ---------- end map_common_to_lation ----------
panel_10 = Panel(map_common_to_lation.a)
item_5 = ListItem(List=ins, Index=nullrep.Items, Wrap=True)  # -> flatten(Item)
number_slider = Slider(2, range=0..10)
division = Division(A=number_slider, B=Slider(2.2, range=0..10))

# ---- group: Bound Tree Geometry
branch_11 = TreeBranch(Tree=entwine, Path="{0;2}", MaintainPaths=True)
volume = Volume(Geometry=branch_11)  # -> Volume, Centroid
circle = CircleCNR(Center=volume.Centroid, Normal=Vector(0, 0, 1), Radius=Slider(7, range=0..10))
brec = BoundingRectangle(Geometry=circle, Plane=PlaneXY(0, 0, 0), Axis=0, Slide=0, Union=False)  # -> Bounding, DimensionX, DimensionY

# ----
entwine_2 = Entwine(Branch00=face.faces, Branch01=face_2.faces, Branch02=face_3.faces, FlattenInputs=True)
tree_branch = TreeBranch(Tree=list_item_5, Path="{0;0}", MaintainPaths=True)
ghpython_script_2 = GhPythonScript(x=tree_branch)  # -> out, a
# ---------- ghpython_script_2: Python ----------
a = x.split(" ")[2].split('\n')[0]
# ---------- end ghpython_script_2 ----------
branch_12 = TreeBranch(Tree=entwine, Path="{0;0}", MaintainPaths=True)
number_grids = GhPythonScript(grid_names=flatten(ghpython_script_2.a))  # -> out, simplify(flatten(final_grid_names)); inputs grid_names: list
# ---------- number_grids: Python ----------
n_grid_names = len(grid_names)
final_grid_names = []
for n,g in enumerate(grid_names):
    final_grid_names.append("facade"+str(n).zfill(2)+"_"+g)
# ---------- end number_grids ----------
mesh_3 = Mesh(branch_12)
flatten = FlattenTree(Tree=ghpython_script_2.a, Path="{0}")
flatten_2 = FlattenTree(Tree=mesh_3, Path="{0}")
lng_6 = ListLength(List=flatten_2)
repeat_4 = RepeatData(Data="facade", Length=flatten(lng_6))  # -> flatten(Data)
flatten_3 = FlattenTree(Tree=number_grids.final_grid_names, Path="{0}")
panel_11 = Panel("Acer_platanoides")

# ---- group: Controls
write_grid_record = Button()
project_directory = FilePath("/Users/jmccarty/Nextcloud/Projects/35_UHI_Trees_Manitoba/00_data_code/jodla_project/")
debug_mode = BooleanToggle(False)
list = ValueList({"Baseline": 0, "Scenario": 1}, selected="Baseline")
write_baseline_materials = Button()
write_tree_inventory = Button()
write_model = Button()
run_simulation = Button()
run_svf = BooleanToggle(False)

# ----
vec = Vector(Vector(0, -86.58851392, 0))
analysisperiod = LBAnalysisPeriod(
    start_month=Slider(6, range=1..12),
    start_day=Slider(21, range=1..31),
    start_hour=Slider(0, range=0..23),
    end_month=Slider(6, range=1..12),
    end_day=Slider(28, range=1..31),
    end_hour=Slider(23, range=0..23),
    timestep=Slider(1, range=1..60))  # -> period, hoys, dates; plug-in component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
panel_12 = Panel(analysisperiod.dates)
reverse = Reverse(Vector=vector_2pt.Vector)

# ---- group: Build Sensor Grid
mesh_4 = Mesh(branch)
bounding_rectangle_2 = BoundingRectangle(Geometry=mesh_4, Plane=PlaneXY(0, 0, 0), Axis=0, Slide=0, Union=True)  # -> Bounding, DimensionX, DimensionY
number_slider_2 = Slider(0.5, range=0..1)
brep = Brep(bounding_rectangle_2.Bounding)
genpts = LBGeneratePointGrid(geometry=brep, grid_size=number_slider, offset_dist=Slider(10, range=0..10))  # -> points, vectors, face_areas, mesh; plug-in component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
unit_z = UnitZ(Factor=1)
reverse_2 = Reverse(Vector=unit_z)
mesh_ray = MeshRay(Mesh=graft(mesh_4), Point=genpts.points, Direction=reverse_2)  # -> Point, Hit
tree_branch_2 = TreeBranch(Tree=list_item_5, Path="{0;1}", MaintainPaths=True)
dispatch_2 = Dispatch(List=mesh_ray.Point, DispatchPattern=mesh_ray.Hit)  # -> ListA, ListB
amplitude = Amplitude(Vector=unit_z, Amplitude=Slider(0.1, range=0..1))
ghpython_script_3 = GhPythonScript(x=tree_branch_2)  # -> out, a; same code as ghpython_script_2
point_2 = Point(dispatch_2.ListA)
move_5 = Move(Geometry=point_2, Motion=amplitude)  # -> simplify(Geometry), Transform
graft_tree = GraftTree(Tree=ghpython_script_3.a, IncludeEmptyLists=True, IncludeNullItems=True)  # -> simplify(Tree)
panel_13 = Panel("jodla_baseline_grid")
clean_tree_3 = CleanTree(RemoveNulls=True, RemoveInvalid=True, RemoveEmpty=True, Tree=move_5.Geometry)
clean_tree_4 = CleanTree(RemoveNulls=True, RemoveInvalid=True, RemoveEmpty=True, Tree=graft_tree)
number_grids_2 = GhPythonScript(grid_names=flatten(clean_tree_4))  # -> out, simplify(graft(final_grid_names)); inputs grid_names: list
# ---------- number_grids_2: Python ----------
n_grid_names = len(grid_names)
final_grid_names = []
for n,g in enumerate(grid_names):
    final_grid_names.append("grid"+str(n).zfill(2)+"_"+g)
# ---------- end number_grids_2 ----------

# ----
area_5 = Area(Geometry=mesh_4)  # -> Area, Centroid
ma = MassAddition(Input=area_5.Area)  # -> Result, PartialResults
lng_7 = ListLength(List=clean_tree_3)
pd = PathDescription(Data=clean_tree_3)
repeat_5 = RepeatData(Data=number_grids_2.final_grid_names, Length=lng_7)  # -> simplify(Data)

# ---- group: Subset Main Grid to Trees
incurves = PointInCurves(Point=clean_tree_3, Curves=brec.Bounding)  # -> Relationship, Index, Point
simplify = SimplifyTree(Tree=incurves.Relationship, Front=False)
listdexs_3 = ListIndices(List=clean_tree_3)
py3 = Python3Script(x=simplify)  # -> out, a; inputs x: Int32
# ---------- py3: Python ----------
if x>=1:
    a = True
else:
    a = False
# ---------- end py3 ----------
dispatch_3 = Dispatch(List=listdexs_3, DispatchPattern=py3.a)  # -> ListA, ListB
dispatch_4 = Dispatch(List=clean_tree_3, DispatchPattern=py3.a)  # -> ListA, ListB
clean = CleanTree(RemoveNulls=True, RemoveInvalid=True, RemoveEmpty=True, Tree=dispatch_4.ListA)
clean_2 = CleanTree(RemoveNulls=True, RemoveInvalid=True, RemoveEmpty=True, Tree=dispatch_3.ListA)
panel_14 = Panel("jodla_scenario_grid")
pdecon_2 = Deconstruct(Point=clean_tree_3)  # -> XComponent, YComponent, ZComponent
item_6 = ListItem(List=pd, Index=clean_2, Wrap=True)
pdecon_3 = Deconstruct(Point=clean)  # -> XComponent, YComponent, ZComponent
item_7 = ListItem(List=repeat_5, Index=clean_2, Wrap=True)

# ----
panel_15 = Panel(listdexs_3)
cullpt = CullDuplicates(Points=flatten(clean), Tolerance=0.1, CullMode=3)  # -> Points, Indices, Valence

# ---- group: Build Sensor Grid (continued)
lng_8 = ListLength(List=flatten(cullpt.Points))
concat = Concatenate(FragmentA=panel_13, FragmentB="_", FragmentC=lng_8, FragmentD="s")

# ----
item_8 = ListItem(List=flatten(item_6), Index=cullpt.Indices, Wrap=True)
item_9 = ListItem(List=flatten(item_7), Index=cullpt.Indices, Wrap=True)
pdecon_4 = Deconstruct(Point=cullpt.Points)  # -> XComponent, YComponent, ZComponent
lng_9 = ListLength(List=flatten(pdecon_4.XComponent))
concat_2 = Concatenate(FragmentA=panel_14, FragmentB="_", FragmentC=lng_9, FragmentD="s")
flatten_4 = FlattenTree(Tree=mesh_4, Path="{0}")
lng_10 = ListLength(List=flatten_4)

# ---- group: Baseline Grid
sensorgrid = HBSensorGrid(name=concat, positions=flatten(cullpt.Points))  # -> grid; plug-in component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

# ---- group: Build Sensor Grid / Separate grids
sensorgrid_2 = HBSensorGrid(name=number_grids_2.final_grid_names, positions=clean_tree_3)  # -> grid; disabled; plug-in component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

# ---- group: Subset Main Grid to Trees / SCenario Grid
sensorgrid_3 = HBSensorGrid(name=concat_2, positions=flatten(cullpt.Points))  # -> grid; plug-in component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

# ----
repeat_6 = RepeatData(Data="ground", Length=flatten(lng_10))  # -> flatten(Data)
flatten_5 = FlattenTree(Tree=ghpython_script_3.a, Path="{0}")
flatten_6 = FlattenTree(Tree=number_grids_2.final_grid_names, Path="{0}")
merge = Merge(Data1=repeat_6, Data2=repeat_4)  # -> flatten(Result)
merge_2 = Merge(Data1=flatten_4, Data2=flatten_2)  # -> flatten(Result)
merge_3 = Merge(Data1=flatten_5, Data2=flatten)  # -> flatten(Result)
merge_4 = Merge(Data1=flatten_6, Data2=flatten_3)  # -> flatten(Result)
make_grid_point_record = Python3Script(x=pdecon_4.XComponent, y=pdecon_4.YComponent, z=pdecon_4.ZComponent, grid=item_8, tree=item_9)  # -> out, flatten(record)
# ---------- make_grid_point_record: Python ----------
record = f"{round(x,5)},{round(y,5)},{round(z,5)},{grid},{tree}\n"
# ---------- end make_grid_point_record ----------

# ---- group: Grid Records
make_grid_point_record_2 = Python3Script(x=pdecon_2.XComponent, y=pdecon_2.YComponent, z=pdecon_2.ZComponent, grid=repeat_5, tree=pd)  # -> out, flatten(record); same code as make_grid_point_record
entwine_3 = Entwine(Branch00=make_grid_point_record.record, Branch01=make_grid_point_record.record, FlattenInputs=True)
entwine_4 = Entwine(Branch00=panel_13, Branch01=panel_14, FlattenInputs=True)
write_list_to_csv = Python3Script(
    header="x_coord,y_coord,z_coord,grid_name,ghp_tree",
    project_directory=project_directory,
    filename=entwine_4,
    debug=debug_mode,
    write=write_grid_record,
    record=entwine_3)  # inputs write: Boolean, record: list
# ---------- write_list_to_csv: Python ----------
import os

if write:
    if debug:
        fname = f"debug_{filename}.csv"
    else:
        fname = f"{filename}.csv"
    filepath = os.path.join(project_directory,"grid_records",fname)
    with open(filepath, "w") as fp:
        fp.writelines([header+"\n"]+record)
# ---------- end write_list_to_csv ----------

# ---- group: surface_materials
panel_16 = Panel(merge_3)

# ---- group: surface areas
area_6 = Area(Geometry=merge_2)  # -> Area, Centroid

# ---- group: Compile
panel_17 = Panel("baseline")
py3_2 = Python3Script(scenario_name=panel_17, grid_name=flatten(merge_4), material_name=panel_16, area_m2=area_6.Area, ground_or_facade=merge)  # -> out, surface_record
# ---------- py3_2: Python ----------
grid_id = grid_name.split("_")[0].replace("grid","").replace("facade","")
surface_record = f"{scenario_name},{grid_id},{material_name},{round(area_m2,2)},{ground_or_facade}\n"
# ---------- end py3_2 ----------

# ---- group: Make Model / Filter Grid
filter = StreamFilter(Gate=list, Stream0=sensorgrid, Stream1=sensorgrid_3)

# ---- group: Make Model
panel_18 = Panel("DLA Study")
model = HBModel(faces=flatten(entwine_2), name=panel_18)  # -> out, model; plug-in component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
assigngridsviews = HBAssignGridsAndViews(model=model.model, grids=flatten(filter))  # -> model; plug-in component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

# ----
write_list_to_csv_2 = Python3Script(
    header="scenario_id,grid_id,material_name,area_m2,ground_or_facade",
    project_directory=project_directory,
    filename="baseline_materials",
    write=write_baseline_materials,
    record=py3_2.surface_record)  # inputs write: Boolean, record: list
# ---------- write_list_to_csv_2: Python ----------
import os

if write:
    filepath = os.path.join(project_directory,"grid_records",f"{filename}.csv")
    with open(filepath, "w") as fp:
        fp.writelines([header+"\n"]+record)
# ---------- end write_list_to_csv_2 ----------

vizall = HBVisualizeAll(hb_objs=flatten(assigngridsviews))  # -> geo; plug-in component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

# ---- group: Simulation Setup
py3_3 = Python3Script(project_directory=project_directory, model_type=list, debug=debug_mode)  # -> out, epw, model_save_folder, model_grasshopper_folder
# ---------- py3_3: Python ----------
import os

# get epw file
epw = os.path.join(project_directory,"weather.epw")

# establish if saving scenario or baseline
if model_type==0:
    model_type_name = "baseline"
else:
    model_type_name = "scenario"

# build folder names
if debug:
    python_model_dir = "python_debug"
else:
    python_model_dir = "python"
model_save_folder = os.path.join(project_directory,python_model_dir,f"{model_type_name}_radiance_project")
model_grasshopper_folder = os.path.join(project_directory,"grasshopper",f"{model_type_name}_radiance_project")

# create dirs if necessary
for fp in [model_save_folder, model_grasshopper_folder]:
    if os.path.exists(fp):
        pass
    else:
        os.makedirs(fp)
# ---------- end py3_3 ----------
radpar = HBRadianceParameter(recipe_type=Slider(2, range=0..2), detail_level=Slider(1, range=0..2))  # -> rad_par; plug-in component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
recipesettings = HBRecipeSettings(folder=py3_3.model_grasshopper_folder, reload_old=False)  # -> settings; plug-in component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
annualirradiance = HBAnnualIrradiance(model=assigngridsviews, wea=py3_3.epw, radiance_par=radpar, run_settings=recipesettings, run=run_simulation)  # -> report, results, res_direct, avg_irr, peak_irr, radiation; plug-in component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
modeltorad = HBModelToRadFolder(model=assigngridsviews, folder=py3_3.model_save_folder, write=write_model)  # -> out, folder; plug-in component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
save_vector = Python3Script(write=[run_simulation, write_model], move_vector=vector_2pt.Vector, radiance_folder=py3_3.model_grasshopper_folder)
# ---------- save_vector: Python ----------
import os

fp = os.path.join(radiance_folder,"vector.txt")

if write:
    with open(fp, "w") as f:
        f.write(move_vector)
# ---------- end save_vector ----------

# ----
wea = HBWeaFromEPW(epw_file=py3_3.epw)  # -> wea; plug-in component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

# ---- group: Tree Points
branch_13 = TreeBranch(Tree=entwine, Path="{0;2}", MaintainPaths=True)
volume_2 = Volume(Geometry=branch_13)  # -> Volume, Centroid
project = Project(Geometry=volume_2.Centroid, Plane=bounding_rectangle_2.Bounding)  # -> Geometry, Transform
listdexs_4 = ListIndices(List=project.Geometry)
pdecon_5 = Deconstruct(Point=project.Geometry)  # -> XComponent, YComponent, ZComponent

# ----
Z_3 = UnitZ(Factor=1)
lng_11 = ListLength(List=volume.Centroid)
repeat_7 = RepeatData(Data=Z_3, Length=lng_11)
repeat_8 = RepeatData(Data="{0,-1,0.5}", Length=lng_11)
sensorgrid_4 = HBSensorGrid(name="svf_trees_up", positions=volume.Centroid, directions=repeat_7)  # -> grid; plug-in component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
sensorgrid_5 = HBSensorGrid(name="svf_trees_south", positions=volume.Centroid, directions=repeat_8)  # -> grid; plug-in component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
entwine_5 = Entwine(Branch00=sensorgrid_4, Branch01=sensorgrid_5, FlattenInputs=True)
assigngridsviews_2 = HBAssignGridsAndViews(model=model.model, grids=flatten(entwine_5))  # -> model; plug-in component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
path_2 = FilePath("/Users/jmccarty/Nextcloud/Projects/35_UHI_Trees_Manitoba/00_data_code/jodla_project/grasshopper/svf/")
recipesettings_2 = HBRecipeSettings(folder=path_2, reload_old=False)  # -> settings; plug-in component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
skyview = HBSkyView(model=assigngridsviews_2, run_settings=recipesettings_2, run=run_svf)  # -> report, results; plug-in component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

flip_2 = FlipMatrix(Data=skyview.results)
avr = Average(Input=flip_2)  # -> flatten(ArithmeticMean)
division_2 = Division(A=avr, B=100)
max = Maximum(A=division_2, B=Slider(0.1, range=0..0.1))

# ---- group: Tree Points (continued)
py3_4 = Python3Script(
    scenario_name=panel_17,
    tree_id=listdexs_4,
    x_coord=pdecon_5.XComponent,
    y_coord=pdecon_5.YComponent,
    z_coord=pdecon_5.ZComponent,
    species=item_5,
    svf=max)  # -> out, tree_record
# ---------- py3_4: Python ----------
tree_record = f"{scenario_name},{str(tree_id).zfill(4)},{round(x_coord,3)},{round(y_coord,3)},{round(z_coord,3)},{species},{round(svf,3)}\n"
# ---------- end py3_4 ----------
write_list_to_csv_3 = Python3Script(
    header="scenario_id,tree_id,x_coord,y_coord,z_coord,species,SVF",
    project_directory=project_directory,
    filename="baseline_trees",
    write=write_tree_inventory,
    record=py3_4.tree_record)  # inputs write: Boolean, record: list; same code as write_list_to_csv_2

# ----
sort_2 = SortList(Keys=max)  # -> Keys, ValuesA

panel_19 = Panel(sort_2.Keys)

# ---- group: Visualize
read_results = BooleanToggle(True)
get_results = Python3Script(x=py3_3.model_grasshopper_folder, read_result=read_results)  # -> out, a
# ---------- get_results: Python ----------
import os 
import glob

a = None
if read_result:
    a1 = glob.glob(os.path.join(x,"annual_irradiance","results","total","*.ill"))
    a2 = [os.path.join(x,"annual_irradiance","results","total","sun-up-hours.txt")]
    a = a1+a2
# ---------- end get_results ----------
getgridsviews = HBGetGridsAndViews(model=assigngridsviews)  # -> views, grids, points, meshes; plug-in component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
hoy = LBCalculateHOY(month=Slider(6, range=1..12), day=Slider(21, range=1..31), hour=Slider(12, range=0..23))  # -> flatten(hoy), flatten(doy), flatten(date); plug-in component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
cumulvalues = HBAnnualCumulativeValues(results=flatten(get_results.a), hoys=hoy.hoy)  # -> out, values; plug-in component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
ghpython_script_4 = GhPythonScript(x=flatten(cumulvalues.values))  # -> out, max, min; inputs x: list
# ---------- ghpython_script_4: Python ----------
max_ = round(max(x),0)
min_ = 0
# ---------- end ghpython_script_4 ----------
gradient = Gradient(
    LowerLimit=ghpython_script_4.min,
    UpperLimit=ghpython_script_4.max,
    Parameter=cumulvalues.values,
    stops=[0: RGB(12, 7, 134), 0.0312: RGB(33, 5, 143), 0.0625: RGB(49, 4, 150), 0.0938: RGB(63, 3, 156), 0.125: RGB(76, 2, 161), 0.156: RGB(89, 1, 164)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])

# ----
move_6 = Move(Geometry=getgridsviews.points, Motion=reverse)  # -> Geometry, Transform
panel_20 = Panel(ghpython_script_4.min)
panel_21 = Panel(hoy.date)

# ---- group: Visualize (continued)
circle_cnr = CircleCNR(Center=move_6.Geometry, Normal=Vector(0, 0, 1), Radius=division)
surface = Surface(circle_cnr)
custom_preview = CustomPreview(Geometry=surface, Material=gradient)  # disabled

# ----
panel_22 = Panel(ghpython_script_4.max)
